# Grasshopper definition Cross-SectionFromBrep.gh (Grasshopper 0.9.76)

# ---- group: Reinforcement
brep = Brep([<brep referenced from the Rhino model> x2])

# ---- group: Concrete
# Determine Cross-section from Brep
# 
# Thomas Dyhr
# 
# 22092017
brep_2 = Brep(<brep referenced from the Rhino model>)

# ----
debrep = DeconstructBrep(Brep=brep_2)  # -> Faces, Edges, Vertices
area = Area(Geometry=debrep.Faces)  # -> Area, Centroid
sort = SortList(Keys=area.Area, ValuesA=debrep.Faces)  # -> Keys, ValuesA
volume = Volume(Geometry=brep_2)  # -> Volume, Centroid
item = ListItem(List=sort.ValuesA, Index=0, Wrap=True)
pl_origin = PlaneOrigin(Base=item, Origin=volume.Centroid)
sec = BrepPlane(Brep=brep, Plane=pl_origin)  # -> Curves, Points
sec_2 = BrepPlane(Brep=brep_2, Plane=pl_origin)  # -> Curves, Points

# ---- group: Rebar section
crv = Curve(sec.Curves)

# ----
explode = Explode(Curve=sec_2.Curves, Recursive=True)  # -> Segments, Vertices

# ---- group: Cross section
cross = Curve(sec_2.Curves)

# ----
cullpt = CullDuplicates(Points=explode.Vertices, Tolerance=0.1, CullMode=3)  # -> Points, Indices, Valence
darc = DeconstructArc(Arc=crv)  # -> BasePlane, Radius, Angle
len = Length(Curve=explode.Segments)
item_2 = ListItem(List=darc.Radius, Index=0, Wrap=True)
pdecon = Deconstruct(Point=cullpt.Points)  # -> XComponent, YComponent, ZComponent
bnd = Bounds(Numbers=len)
bnd_2 = Bounds(Numbers=pdecon.ZComponent)
expression = Expression(x=item_2, Expression="x^2*π")
dedomain = DeconstructDomain(Domain=bnd)  # -> Start, End
dedomain_2 = DeconstructDomain(Domain=bnd_2)  # -> Start, End
height = Number(dedomain.End)
width = Number(dedomain.Start)
round = Round(Number=expression)  # -> Nearest, Floor, Ceiling
mindex = MemberIndex(Set=pdecon.ZComponent, Member=dedomain_2.Start)  # -> Index, Count
item_3 = ListItem(List=cullpt.Points, Index=mindex.Index, Wrap=True)

# ---- group: Area of 1 rebar
num = Number(round.Floor)

# ----
panel = Panel(round.Floor)
item_4 = ListItem(List=item_3, Index=0, Wrap=True)

# ---- group: Base point for plane
pt = Point(item_4)

# ----
mindex_2 = MemberIndex(Set=cullpt.Points, Member=pt)  # -> Index, Count
pt_2 = Point(flatten(darc.BasePlane))
cull_i = CullIndex(List=cullpt.Points, Indices=mindex_2.Index, Wrap=True)
lng = ListLength(List=pt_2)
cp = ClosestPoint(Point=pt, Cloud=cull_i)  # -> ClosestPoint, CPIndex, Distance
mindex_3 = MemberIndex(Set=cull_i, Member=cp.ClosestPoint)  # -> Index, Count
division = Division(A=lng, B=2)
round_2 = Round(Number=division)  # -> Nearest, Floor, Ceiling
cull_i_2 = CullIndex(List=cull_i, Indices=mindex_3.Index, Wrap=True)
cps = ClosestPoints(Point=pt, Cloud=pt_2, Count=round_2.Ceiling)  # -> ClosestPoint, CPIndex, Distance
cp_2 = ClosestPoint(Point=pt, Cloud=cull_i_2)  # -> ClosestPoint, CPIndex, Distance

# ---- group: X-axis
vec2pt = Vector2Pt(PointA=pt, PointB=cp.ClosestPoint, Unitize=False)  # -> Vector, Length

# ---- group: Y-axis
vec2pt_2 = Vector2Pt(PointA=pt, PointB=cp_2.ClosestPoint, Unitize=False)  # -> Vector, Length

# ---- group: Center points for rebars
pt_3 = Point(cps.ClosestPoint)

# ----
pl = ConstructPlane(Origin=pt, XAxis=vec2pt.Vector, YAxis=vec2pt_2.Vector)
cp_3 = PlaneClosestPoint(Point=pt_3, Plane=pl)  # -> Point, UVPoint, Distance
panel_2 = Panel(cp_3.UVPoint)

# ---- group: Pt (Coordinates) for temp. calculation
pt_4 = Point(cp_3.UVPoint)
